# Grasshopper definition docString.gh (Grasshopper 1.0.7)

radius = GetNumber(Slider(100, range=10..100), AtLeast=1, AtMost=2147483647, Maximum=1.797693135e+308, Minimum=-1.797693135e+308)
pi = Pi(Factor=2)
count = GetNumber(Slider(10, range=10..100), AtLeast=1, AtMost=2147483647, Maximum=1.797693135e+308, Minimum=-1.797693135e+308)
range = Range(Domain=pi, Steps=count)
mesh = Mesh(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)
pt = PointPolar(BasePlane=PlaneXY(0, 0, 0), XYAngle=range, ZAngle=0, Offset=radius)
series = Series(Start=0, Step=1, Count=count)
shift = ShiftList(List=pt, Shift=1, Wrap=invert(True))
move = Move(Geometry=mesh, Motion=shift)  # -> Geometry, Transform
gradient = Gradient(
    LowerLimit=0,
    UpperLimit=count,
    Parameter=series,
    stops=[0: RGB(234, 38, 0), 0.221: RGB(234, 126, 0), 0.347: RGB(198, 115, 144), 0.5: RGB(254, 244, 84), 0.75: RGB(173, 203, 249), 0.872: RGB(226, 193, 100), 1: RGB(75, 107, 169)])
material = CreateMaterial(Diffuse=gradient, Specular=RGB(255, 255, 255), Emission=RGB(0, 0, 0), Transparency=0, Shine=0)
c_script = CSharpScript(objects=simplify(graft(move.Geometry)), materials=simplify(graft(material)))  # -> out, str; inputs objects: tree, materials: tree
# ---------- c_script: C# ----------
    if(objects.BranchCount != materials.BranchCount) return;

    var doc = new Rhino.FileIO.File3dm();

    //go through branches
    for(int i = 0; i < objects.BranchCount; i++)
    {
      var mat = materials.Branches[i][0] as Rhino.Display.DisplayMaterial;
      var objs = objects.Branches[i];

      var material = new Rhino.DocObjects.Material();
      material.DiffuseColor = mat.Diffuse;
      material.EmissionColor = mat.Emission;
      material.Transparency = mat.Transparency;
      material.Shine = mat.Shine;
      material.SpecularColor = mat.Specular;
      material.Name = "sku";

      var atts = new Rhino.DocObjects.ObjectAttributes();
      atts.MaterialSource = Rhino.DocObjects.ObjectMaterialSource.MaterialFromObject;

      doc.AllMaterials.Add(material);
      atts.MaterialIndex = i;

      for(int j = 0; j < objs.Count; j++)
      {
        var obj = objs[j] as Rhino.Geometry.GeometryBase;
        Print(obj.ToString());

        switch(obj.ObjectType)
        {
          case Rhino.DocObjects.ObjectType.Curve:
            doc.Objects.AddCurve(obj as Curve, atts);
            break;
          case Rhino.DocObjects.ObjectType.Mesh:
            doc.Objects.AddMesh(obj as Mesh, atts);
            break;
        }
      }

    }

    var fwo = new Rhino.FileIO.File3dmWriteOptions();
    fwo.Version = 7;
    var arr = doc.ToByteArray(fwo);

    str = Convert.ToBase64String(arr);

    doc.Dispose();
# ---------- end c_script ----------
preview = CustomPreview(Geometry=move.Geometry, Material=material)

# ---- group: RH_OUT:docString
txt = Text(c_script.str)
