# Grasshopper definition test-mcnell.gh (Grasshopper 1.0.7)
# plug-ins: Human

_3dm = Import3DM(File="C:\Dummy\jwln0300 (4).dxf", Layer="*", Name="*")
crv = Curve(_3dm)

runion = RegionUnion(Curves=crv)
area = Area(Geometry=runion)  # -> Area, Centroid
pt = Point(area.Centroid)
pt_2 = Point(Point(-0.006767543522, -0.007467882874, 0))
ln = Line(StartPoint=pt, EndPoint=pt_2)
move = Move(Geometry=crv, Motion=ln)  # -> Geometry, Transform

list = ValueList({"Silver": .81, "10k gold": .5, "14k gold": .5}, selected="Silver")
brep = Brep(move.Geometry)
boundary = BoundarySurfaces(Edges=brep)
Z = UnitZ(Factor=list)
extr = Extrude(Base=boundary, Direction=Z)
num = Number(0.1)
scale = Scale(Geometry=extr, Center=Point(0, 0, 0), Factor=num)  # -> Geometry, Transform
geo = Geometry(scale.Geometry)
mesh = Mesh(geo)
surfacemap = SurfaceMapping(Mesh=mesh, Surface=boundary)
python_renderassignmaterialtoobjects = GhPythonScript(mesh=surfacemap, material_name="KR", object_name="my_object_name")  # -> out, a
# ---------- python_renderassignmaterialtoobjects: Python ----------
"""Provides a scripting component.
    Inputs:
        mesh: mesh ghdoc when geometry
        object_name: string
        material_name: string
    Output:
        a: The a output variable"""

__author__ = "User"
__version__ = "2021.06.15"

import rhinoscriptsyntax as rs
import scriptcontext
import Rhino

#get object properties
obj_id = mesh
doc_object = rs.coercerhinoobject(obj_id)
attributes = doc_object.Attributes
attributes.Name = object_name
geometry = doc_object.Geometry

#go to Rhino workspace
scriptcontext.doc = Rhino.RhinoDoc.ActiveDoc

#bake and select object
rhino_obj = scriptcontext.doc.Objects.Add(geometry, attributes)
rs.SelectObject(rhino_obj)

if material_name == "KY":
    rs.Command("RenderAssignMaterialToObjects" " KY" " Enter")
elif material_name == "KW":
    rs.Command("RenderAssignMaterialToObjects" " KW" " Enter")
elif material_name == "KR":
    rs.Command("RenderAssignMaterialToObjects" " KR" " Enter")
elif material_name == "SS":
    rs.Command("RenderAssignMaterialToObjects" " SS" " Enter")
else: 
    rs.Command("RenderAssignMaterialToObjects" " SS" " Enter")

#back to GH workspace
scriptcontext.doc = ghdoc

#return
a = rhino_obj
# ---------- end python_renderassignmaterialtoobjects ----------
c_script = CSharpScript(mesh=python_renderassignmaterialtoobjects.a)  # -> base64Draco; inputs mesh: Mesh
# ---------- c_script: C# ----------
    var options = new Rhino.FileIO.DracoCompressionOptions();
    options.CompressionLevel = 5;
    options.IncludeTextureCoordinates = false;
    options.IncludeVertexColors = false;

    var compressed = Rhino.FileIO.DracoCompression.Compress(mesh, options);
    base64Draco = compressed.ToBase64String();
# ---------- end c_script ----------
panel = Panel(python_renderassignmaterialtoobjects.a)
txt = Text(c_script)
