# Grasshopper definition value_list_12.gh (Grasshopper 1.0.7)

# ---- group: RH_IN:path
txt = Text("C:\Dummy\JWLN0300.dxf")

# ----
panel = Panel(txt)

_3dm = Import3DM(File=panel, Layer="*", Name="*")
crv = Curve(_3dm)

list = ValueList({"Yellow Gold": 0, "Rose Gold": 1, "White Gold": 2, "Silver": 3}, selected="Yellow Gold")
pt = Point(Point(0, 0, 0))

runion = RegionUnion(Curves=crv)
area = Area(Geometry=runion)  # -> Area, Centroid
pt_2 = Point(area.Centroid)
ln = Line(StartPoint=pt_2, EndPoint=pt)
move = Move(Geometry=crv, Motion=ln)  # -> flatten(Geometry), Transform

# ---- group: RH_IN:number
int = Integer(list)

# ----
srf = Surface(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)
srfsplit = SurfaceSplit(Surface=srf, Curves=move.Geometry)
amoments = AreaMoments(Geometry=srfsplit)  # -> Area, Centroid, Inertia, InertiaError, Secondary, SecondaryError, Gyration
number_slider = Slider(0.1, range=0..1)
cp = ClosestPoint(Point=pt, Cloud=amoments.Centroid)  # -> ClosestPoint, CPIndex, Distance
item = ListItem(List=srfsplit, Index=cp.CPIndex, Wrap=True)
num = Number(0.051)
scale_nu = ScaleNU(Geometry=item, Plane=PlaneXY(0, 0, 0), ScaleX=number_slider, ScaleY=number_slider, ScaleZ=1)  # -> Geometry, Transform
num_2 = Number(0.081)
filter = StreamFilter(Gate=int, Stream0=num, Stream1=num, Stream2=num, Stream3=num_2)
Z = UnitZ(Factor=filter)
extr = Extrude(Base=scale_nu.Geometry, Direction=Z)
num_3 = Number(0)

# ---- group: RH_OUT:mesh
mesh = Mesh(extr)

# ----
filter_2 = StreamFilter(
    Gate=int,
    Stream0=ColourSwatch(SwatchColor=RGB(242, 212, 39)),
    Stream1=ColourSwatch(SwatchColor=RGB(227, 188, 195)),
    Stream2=ColourSwatch(SwatchColor=RGB(143, 148, 147)),
    Stream3=ColourSwatch(SwatchColor=RGB(204, 204, 204)))

# ---- group: RH_OUT:material
material = CreateMaterial(
    Diffuse=filter_2,
    Specular=ColourSwatch(SwatchColor=RGB(255, 245, 207)),
    Emission=ColourSwatch(SwatchColor=RGB(104, 103, 107)),
    Transparency=num_3,
    Shine=Slider(97, range=0..100))

# ----
preview = CustomPreview(Geometry=mesh, Material=material)
