# Grasshopper definition value_list_2.gh (Grasshopper 1.0.7)

vec = VectorXYZ(XComponent=Slider(4, range=0..10), YComponent=Slider(6, range=0..10), ZComponent=Slider(8, range=0..10))  # -> Vector, Length

# ---- group: RH_OUT:spheres
c_script = CSharpScript(rad=Slider(5, range=0..100), vec=vec.Vector)  # -> out, A; inputs loc: Point3d, rad: Double, vec: Vector3d
# ---------- c_script: C# ----------
    movedPt = loc;
    MovePoint(vec);

    // A = MeshSphere(movedPt, rad);
    A = MeshBox();
# ---------- c_script: C# additional code ----------
  Point3d movedPt = new Point3d();

  Mesh MeshSphere(Point3d location, double radius)
  {
    Sphere bSphere = new Sphere(location, radius);

    Mesh mSphere = Mesh.CreateFromSphere(bSphere, 10, 10);
    return mSphere;
  }

  Mesh MeshBox()
  {
    Rhino.Geometry.Point3d pt0 = new Rhino.Geometry.Point3d(0, 0, 0);
    Rhino.Geometry.Point3d pt1 = new Rhino.Geometry.Point3d(10, 10, 10);
    Rhino.Geometry.BoundingBox box = new Rhino.Geometry.BoundingBox(pt0, pt1);
    Rhino.Geometry.Brep brep = box.ToBrep();
    Mesh mBox = Mesh.CreateFromBrep(brep)[0];
    return mBox;
  }


  void MovePoint(Vector3d moveVec)
  {
    movedPt += moveVec;
  }
# ---------- end c_script ----------

# ----
panel = Panel(c_script.A)
