# Grasshopper definition value_list_3.gh (Grasshopper 1.0.7)

_3dm = Import3DM(File="C:\Dummy\jwln0300 (4).dxf", Layer="*", Name="*")
crv = Curve(_3dm)

runion = RegionUnion(Curves=crv)
area = Area(Geometry=runion)  # -> Area, Centroid
pt = Point(Point(-0.006767543522, -0.007467882874, 0))
pt_2 = Point(area.Centroid)
ln = Line(StartPoint=pt_2, EndPoint=pt)
move = Move(Geometry=crv, Motion=ln)  # -> Geometry, Transform

custom_mesh_settings = SettingsCustom(
    StitchSeams=True,
    SimplePlanes=False,
    Refine=True,
    MinCount=16,
    MaxCount=400,
    AspectRatio=20,
    MaxDistance=0,
    MaxAngle=20,
    MinEdge=0,
    MaxEdge=0)
brep = Brep(move.Geometry)
mesh = MeshBrep(Brep=brep, Settings=custom_mesh_settings)

# ---- group: RH_OUT:spheres
mesh_2 = Mesh(mesh)
