# Grasshopper definition value_list_4.gh (Grasshopper 1.0.7)

path = FilePath("C:\Dummy\jwln0300 (1).dxf")

_3dm = Import3DM(File=path, Layer="*", Name="*")
crv = Curve(_3dm)

pt = Point(Point(0, 0, 0))

runion = RegionUnion(Curves=crv)
area = Area(Geometry=runion)  # -> Area, Centroid
pt_2 = Point(area.Centroid)
ln = Line(StartPoint=pt_2, EndPoint=pt)
move = Move(Geometry=crv, Motion=ln)  # -> flatten(Geometry), Transform

srf = Surface(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)
srfsplit = SurfaceSplit(Surface=srf, Curves=move.Geometry)
amoments = AreaMoments(Geometry=srfsplit)  # -> Area, Centroid, Inertia, InertiaError, Secondary, SecondaryError, Gyration
cp = ClosestPoint(Point=pt, Cloud=amoments.Centroid)  # -> ClosestPoint, CPIndex, Distance
item = ListItem(List=srfsplit, Index=cp.CPIndex, Wrap=True)
number_slider = Slider(0.1, range=0..0.1)
scale_nu = ScaleNU(Geometry=item, Plane=PlaneXY(0, 0, 0), ScaleX=number_slider, ScaleY=number_slider, ScaleZ=1)  # -> Geometry, Transform
list = ValueList({"Silver": .081, "10k gold": .05, "14k gold": .05}, selected="Silver")
Z = UnitZ(Factor=list)
extr = Extrude(Base=scale_nu.Geometry, Direction=Z)

# ---- group: RH_OUT:spheres
mesh = Mesh(extr)
