# Grasshopper definition value_list_6.gh (Grasshopper 1.0.7)

path = FilePath("C:\Dummy\jwln0300 (1).dxf")

_3dm = Import3DM(File=path, Layer="*", Name="*")
crv = Curve(_3dm)

pt = Point(Point(0, 0, 0))

runion = RegionUnion(Curves=crv)
area = Area(Geometry=runion)  # -> Area, Centroid
pt_2 = Point(area.Centroid)
ln = Line(StartPoint=pt_2, EndPoint=pt)
move = Move(Geometry=crv, Motion=ln)  # -> flatten(Geometry), Transform

srf = Surface(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)
srfsplit = SurfaceSplit(Surface=srf, Curves=move.Geometry)
amoments = AreaMoments(Geometry=srfsplit)  # -> Area, Centroid, Inertia, InertiaError, Secondary, SecondaryError, Gyration
cp = ClosestPoint(Point=pt, Cloud=amoments.Centroid)  # -> ClosestPoint, CPIndex, Distance
item = ListItem(List=srfsplit, Index=cp.CPIndex, Wrap=True)
number_slider = Slider(0.1, range=0..0.1)
scale_nu = ScaleNU(Geometry=item, Plane=PlaneXY(0, 0, 0), ScaleX=number_slider, ScaleY=number_slider, ScaleZ=1)  # -> Geometry, Transform
list = ValueList({"Silver": .081, "10k gold": .05, "14k gold": .05}, selected="Silver")
Z = UnitZ(Factor=list)
extr = Extrude(Base=scale_nu.Geometry, Direction=Z)
mesh = Mesh(extr)
num = Number(0)
material = CreateMaterial(
    Diffuse=ColourSwatch(SwatchColor=RGB(227, 188, 195)),
    Specular=ColourSwatch(SwatchColor=RGB(255, 245, 207)),
    Emission=ColourSwatch(SwatchColor=RGB(104, 103, 107)),
    Transparency=num,
    Shine=Slider(97, range=0..100))
c_script = CSharpScript(objects=simplify(graft(mesh)), materials=simplify(graft(material)))  # -> out, str; inputs objects: tree, materials: tree
# ---------- c_script: C# ----------
    if(objects.BranchCount != materials.BranchCount) return;

    var doc = new Rhino.FileIO.File3dm();

    //go through branches
    for(int i = 0; i < objects.BranchCount; i++)
    {
      var mat = materials.Branches[i][0] as Rhino.Display.DisplayMaterial;
      var objs = objects.Branches[i];

      var material = new Rhino.DocObjects.Material();
      material.DiffuseColor = mat.Diffuse;
      material.EmissionColor = mat.Emission;
      material.Transparency = mat.Transparency;
      material.Shine = mat.Shine;
      material.SpecularColor = mat.Specular;
      material.Name = "sku";

      var atts = new Rhino.DocObjects.ObjectAttributes();
      atts.MaterialSource = Rhino.DocObjects.ObjectMaterialSource.MaterialFromObject;

      doc.AllMaterials.Add(material);
      atts.MaterialIndex = i;
      atts.Name = "object_name";

      for(int j = 0; j < objs.Count; j++)
      {
        var obj = objs[j] as Rhino.Geometry.GeometryBase;
        Print(obj.ToString());

        switch(obj.ObjectType)
        {
          case Rhino.DocObjects.ObjectType.Curve:
            doc.Objects.AddCurve(obj as Curve, atts);
            break;
          case Rhino.DocObjects.ObjectType.Mesh:
            doc.Objects.AddMesh(obj as Mesh, atts);
            break;
        }
      }
    }

    var fwo = new Rhino.FileIO.File3dmWriteOptions();
    fwo.Version = 7;

    var arr = doc.ToByteArray(fwo);
    str = Convert.ToBase64String(arr);

    doc.Dispose();
# ---------- end c_script ----------
panel = Panel(c_script.out)

# ---- group: RH_OUT:spheres
txt = Text(c_script.str)

# ----
preview = CustomPreview(Geometry=mesh, Material=material)
