# Grasshopper definition value_list_9.gh (Grasshopper 1.0.7)

# ---- group: RH_IN:path
txt = Text("C:\Dummy\JWLN0300.dxf")

# ----
panel = Panel(txt)

_3dm = Import3DM(File=panel, Layer="*", Name="*")
crv = Curve(_3dm)

list = ValueList({"Yellow Gold": 0, "Rose Gold": 1, "White Gold": 2, "Silver": 3}, selected="Yellow Gold")
pt = Point(Point(0, 0, 0))

runion = RegionUnion(Curves=crv)
area = Area(Geometry=runion)  # -> Area, Centroid
pt_2 = Point(area.Centroid)
ln = Line(StartPoint=pt_2, EndPoint=pt)
move = Move(Geometry=crv, Motion=ln)  # -> flatten(Geometry), Transform

# ---- group: RH_IN:number
int = Integer(list)

# ----
srf = Surface(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)
srfsplit = SurfaceSplit(Surface=srf, Curves=move.Geometry)
amoments = AreaMoments(Geometry=srfsplit)  # -> Area, Centroid, Inertia, InertiaError, Secondary, SecondaryError, Gyration
number_slider = Slider(0.1, range=0..1)
cp = ClosestPoint(Point=pt, Cloud=amoments.Centroid)  # -> ClosestPoint, CPIndex, Distance
item = ListItem(List=srfsplit, Index=cp.CPIndex, Wrap=True)
num = Number(0.051)
scale_nu = ScaleNU(Geometry=item, Plane=PlaneXY(0, 0, 0), ScaleX=number_slider, ScaleY=number_slider, ScaleZ=1)  # -> Geometry, Transform
num_2 = Number(0.081)
filter = StreamFilter(Gate=int, Stream0=num, Stream1=num, Stream2=num, Stream3=num_2)
Z = UnitZ(Factor=filter)
extr = Extrude(Base=scale_nu.Geometry, Direction=Z)
num_3 = Number(0)
mesh = Mesh(extr)
panel_2 = Panel(mesh)
python_renderassignmaterialtoobjects = GhPythonScript(mesh=mesh)  # -> out, a
# ---------- python_renderassignmaterialtoobjects: Python ----------
"""Provides a scripting component.
    Inputs:
        mesh: mesh ghdoc when geometry
        object_name: string
        material_name: string
    Output:
        a: The a output variable"""

__author__ = "User"
__version__ = "2021.06.15"

import rhinoscriptsyntax as rs
import scriptcontext
import Rhino

#get object properties
obj_id = mesh
doc_object = rs.coercerhinoobject(obj_id)

attributes = doc_object.Attributes
attributes.Name = object_name
geometry = doc_object.Geometry

#go to Rhino workspace
scriptcontext.doc = Rhino.RhinoDoc.ActiveDoc

#bake and select object
rhino_obj = scriptcontext.doc.Objects.Add(geometry, attributes)
rs.SelectObject(rhino_obj)

#if material_name == "KY":
#    rs.Command("RenderAssignMaterialToObjects" " KY" " Enter")
#elif material_name == "KW":
#    rs.Command("RenderAssignMaterialToObjects" " KW" " Enter")
#elif material_name == "KR":
#    rs.Command("RenderAssignMaterialToObjects" " KR" " Enter")
#elif material_name == "SS":
#    rs.Command("RenderAssignMaterialToObjects" " SS" " Enter")
#else: 
#    rs.Command("RenderAssignMaterialToObjects" " SS" " Enter")

#back to GH workspace
scriptcontext.doc = ghdoc

#return
a = rhino_obj
# ---------- end python_renderassignmaterialtoobjects ----------
filter_2 = StreamFilter(
    Gate=int,
    Stream0=ColourSwatch(SwatchColor=RGB(242, 212, 39)),
    Stream1=ColourSwatch(SwatchColor=RGB(227, 188, 195)),
    Stream2=ColourSwatch(SwatchColor=RGB(143, 148, 147)),
    Stream3=ColourSwatch(SwatchColor=RGB(204, 204, 204)))
material = CreateMaterial(
    Diffuse=filter_2,
    Specular=ColourSwatch(SwatchColor=RGB(255, 245, 207)),
    Emission=ColourSwatch(SwatchColor=RGB(104, 103, 107)),
    Transparency=num_3,
    Shine=Slider(97, range=0..100))
panel_3 = Panel(python_renderassignmaterialtoobjects.a)
c_script = CSharpScript(objects=simplify(graft(python_renderassignmaterialtoobjects.a)), materials=simplify(graft(material)))  # -> out, str; inputs objects: tree, materials: tree
# ---------- c_script: C# ----------
    if(objects.BranchCount != materials.BranchCount) return;

    var doc = new Rhino.FileIO.File3dm();

    //go through branches
    for(int i = 0; i < objects.BranchCount; i++)
    {
      var mat = materials.Branches[i][0] as Rhino.Display.DisplayMaterial;
      var objs = objects.Branches[i];

      var material = new Rhino.DocObjects.Material();
      material.DiffuseColor = mat.Diffuse;
      material.EmissionColor = mat.Emission;
      material.Transparency = mat.Transparency;
      material.Shine = mat.Shine;
      material.SpecularColor = mat.Specular;
      material.Name = "sku";

      var atts = new Rhino.DocObjects.ObjectAttributes();
      atts.MaterialSource = Rhino.DocObjects.ObjectMaterialSource.MaterialFromObject;

      doc.AllMaterials.Add(material);
      atts.MaterialIndex = i;
      atts.Name = "object_name";

      for(int j = 0; j < objs.Count; j++)
      {
        var obj = objs[j] as Rhino.Geometry.GeometryBase;
        Print(obj.ToString());

        switch(obj.ObjectType)
        {
          case Rhino.DocObjects.ObjectType.Curve:
            doc.Objects.AddCurve(obj as Curve, atts);
            break;
          case Rhino.DocObjects.ObjectType.Mesh:
            doc.Objects.AddMesh(obj as Mesh, atts);
            break;
        }
      }
    }

    var fwo = new Rhino.FileIO.File3dmWriteOptions();
    fwo.Version = 7;

    var arr = doc.ToByteArray(fwo);
    str = Convert.ToBase64String(arr);

    doc.Dispose();
# ---------- end c_script ----------

# ---- group: RH_OUT:mesh
txt_2 = Text(c_script.str)

# ----
preview = CustomPreview(Geometry=mesh, Material=material)
panel_4 = Panel(c_script.out)
